# Grasshopper definition qodo_assignment.gh (Grasshopper 1.0.8)

path = FilePath("I:\Mi unidad\_MPDA\AT\AP\MPDA25-Session04\qodo\assignment01.py")
file = ReadFile(File=path, PerLineParse=False)
py3 = Python3Script(script=file, x_points=Slider(10, range=0..10), y_points=Slider(10, range=0..10))  # -> out, a, b, c, d
panel = Panel(py3.c)
panel_2 = Panel(py3.a)
panel_3 = Panel(py3.b)
panel_4 = Panel(py3.d)
